# Grasshopper definition compfab_final_clean.gh (Grasshopper 1.0.8)
# plug-ins: PTComponentLibrary

subtraction = Subtraction(A="40.014319", B="39.998771")
subtraction_2 = Subtraction(A="-105.256969", B="-105.276882")
subtraction_3 = Subtraction(A="40.014319", B="39.998771")
subtraction_4 = Subtraction(A="-105.256969", B="-105.276882")
subtraction_5 = Subtraction(A="40.014319", B="39.998771")
subtraction_6 = Subtraction(A="-105.256969", B="-105.276882")
subtraction_7 = Subtraction(A="40.014319", B="39.998771")
subtraction_8 = Subtraction(A="-105.256969", B="-105.276882")
subtraction_9 = Subtraction(A="40.014319", B="39.998771")
subtraction_10 = Subtraction(A="-105.256969", B="-105.276882")
subtraction_11 = Subtraction(A="40.014319", B="39.998771")
subtraction_12 = Subtraction(A="40.014319", B="39.998771")
subtraction_13 = Subtraction(A="-105.256969", B="-105.276882")
panel = Panel(subtraction)
panel_2 = Panel(subtraction_2)
subtraction_14 = Subtraction(A="-105.256969", B="-105.276882")
panel_3 = Panel(subtraction_3)
panel_4 = Panel(subtraction_4)
panel_5 = Panel(subtraction_5)
panel_6 = Panel(subtraction_6)
panel_7 = Panel(subtraction_7)
panel_8 = Panel(subtraction_8)
panel_9 = Panel(subtraction_10)
panel_10 = Panel(subtraction_9)
panel_11 = Panel(subtraction_11)
panel_12 = Panel(subtraction_13)
panel_13 = Panel(subtraction_12)
panel_14 = Panel(subtraction_14)
subtraction_15 = Subtraction(A="-105.261052", B="-105.276882")
subtraction_16 = Subtraction(A="-105.259657", B="-105.276882")
subtraction_17 = Subtraction(A="40.002976", B="39.998771")
subtraction_18 = Subtraction(A="40.005056", B="39.998771")
subtraction_19 = Subtraction(A="-105.268634", B="-105.276882")
subtraction_20 = Subtraction(A="40.004107", B="39.998771")
subtraction_21 = Subtraction(A="-105.269971", B="-105.276882")
subtraction_22 = Subtraction(A="40.006290", B="39.998771")
subtraction_23 = Subtraction(A="-105.267768", B="-105.276882")
subtraction_24 = Subtraction(A="40.008481", B="39.998771")
subtraction_25 = Subtraction(A="-105.267210", B="-105.276882")
subtraction_26 = Subtraction(A="-105.261919", B="-105.276882")
subtraction_27 = Subtraction(A="40.006073", B="39.998771")
subtraction_28 = Subtraction(A="40.007359", B="39.998771")
division = Division(A=subtraction_15, B=panel_2)
division_2 = Division(A=subtraction_16, B=panel_4)
division_3 = Division(A=subtraction_17, B=panel)
division_4 = Division(A=subtraction_19, B=panel_6)
division_5 = Division(A=subtraction_18, B=panel_3)
division_6 = Division(A=subtraction_20, B=panel_5)
division_7 = Division(A=subtraction_21, B=panel_8)
division_8 = Division(A=subtraction_22, B=panel_7)
division_9 = Division(A=subtraction_23, B=panel_9)
division_10 = Division(A=subtraction_24, B=panel_10)
division_11 = Division(A=subtraction_25, B=panel_12)
division_12 = Division(A=subtraction_26, B=panel_14)
division_13 = Division(A=subtraction_27, B=panel_11)
division_14 = Division(A=subtraction_28, B=panel_13)
multiplication = Multiplication(A=division_3, B=Slider(100, range=0..100))
multiplication_2 = Multiplication(A=division_5, B=Slider(100, range=0..100))
multiplication_3 = Multiplication(A=division_6, B=Slider(100, range=0..100))
multiplication_4 = Multiplication(A=division_8, B=Slider(100, range=0..100))
multiplication_5 = Multiplication(A=division_10, B=Slider(100, range=0..100))
multiplication_6 = Multiplication(A=division, B=Slider(100, range=0..100))
multiplication_7 = Multiplication(A=division_2, B=Slider(100, range=0..100))
multiplication_8 = Multiplication(A=division_13, B=Slider(100, range=0..100))
multiplication_9 = Multiplication(A=division_14, B=Slider(100, range=0..100))
multiplication_10 = Multiplication(A=division_4, B=Slider(100, range=0..100))
multiplication_11 = Multiplication(A=division_7, B=Slider(100, range=0..100))
multiplication_12 = Multiplication(A=division_9, B=Slider(100, range=0..100))
multiplication_13 = Multiplication(A=division_11, B=Slider(100, range=0..100))
multiplication_14 = Multiplication(A=division_12, B=Slider(100, range=0..100))
construct_point = ConstructPoint(XCoordinate=multiplication_6, YCoordinate=multiplication, ZCoordinate=Slider(20, range=0..100))
construct_point_2 = ConstructPoint(XCoordinate=multiplication_7, YCoordinate=multiplication_2, ZCoordinate=Slider(20, range=0..100))
construct_point_3 = ConstructPoint(XCoordinate=multiplication_10, YCoordinate=multiplication_3, ZCoordinate=Slider(20, range=0..100))
construct_point_4 = ConstructPoint(XCoordinate=multiplication_11, YCoordinate=multiplication_4, ZCoordinate=Slider(20, range=0..100))
geometry = Geometry(<mesh referenced from the Rhino model>)
construct_point_5 = ConstructPoint(XCoordinate=multiplication_12, YCoordinate=multiplication_5, ZCoordinate=Slider(20, range=0..100))
geometry_2 = Geometry(<mesh referenced from the Rhino model>)
construct_point_6 = ConstructPoint(XCoordinate=multiplication_13, YCoordinate=multiplication_8, ZCoordinate=Slider(20, range=0..100))
construct_point_7 = ConstructPoint(XCoordinate=multiplication_14, YCoordinate=multiplication_9, ZCoordinate=Slider(20, range=0..100))
geometry_3 = Geometry(<mesh referenced from the Rhino model>)
geometry_4 = Geometry(<mesh referenced from the Rhino model>)
geometry_5 = Geometry(<mesh referenced from the Rhino model>)
geometry_6 = Geometry(<mesh referenced from the Rhino model>)
geometry_7 = Geometry(<mesh referenced from the Rhino model>)

mesh_closest_point = MeshClosestPoint(Point=construct_point, Mesh=geometry)  # -> Point, Index, Parameter
mesh_closest_point_2 = MeshClosestPoint(Point=construct_point_2, Mesh=geometry_2)  # -> Point, Index, Parameter
mesh_closest_point_3 = MeshClosestPoint(Point=construct_point_4, Mesh=geometry_4)  # -> Point, Index, Parameter
mesh_closest_point_4 = MeshClosestPoint(Point=construct_point_3, Mesh=geometry_3)  # -> Point, Index, Parameter
mesh_closest_point_5 = MeshClosestPoint(Point=construct_point_5, Mesh=geometry_5)  # -> Point, Index, Parameter
mesh_closest_point_6 = MeshClosestPoint(Point=construct_point_6, Mesh=geometry_6)  # -> Point, Index, Parameter
mesh_closest_point_7 = MeshClosestPoint(Point=construct_point_7, Mesh=geometry_7)  # -> Point, Index, Parameter

number_slider = Slider(2, range=0..10)
number_slider_2 = Slider(1.2, range=0..10)
number_slider_3 = Slider(2, range=0..10)
number_slider_4 = Slider(1.2, range=0..10)
number_slider_5 = Slider(2, range=0..10)
number_slider_6 = Slider(1.2, range=0..10)
number_slider_7 = Slider(2, range=0..10)
number_slider_8 = Slider(1.2, range=0..10)
number_slider_9 = Slider(2, range=0..10)
number_slider_10 = Slider(1.2, range=0..10)
number_slider_11 = Slider(2, range=0..10)
number_slider_12 = Slider(1.2, range=0..10)
number_slider_13 = Slider(2, range=0..10)
number_slider_14 = Slider(1.2, range=0..10)
negative = Negative(Value=number_slider)
negative_2 = Negative(Value=number_slider_3)
cylinder = Cylinder(Base=mesh_closest_point_2.Point, Radius=number_slider_2, Length=number_slider)
negative_3 = Negative(Value=number_slider_5)
cylinder_2 = Cylinder(Base=mesh_closest_point.Point, Radius=number_slider_4, Length=number_slider_3)
cylinder_3 = Cylinder(Base=mesh_closest_point_3.Point, Radius=number_slider_6, Length=number_slider_5)
negative_4 = Negative(Value=number_slider_7)
negative_5 = Negative(Value=number_slider_9)
negative_6 = Negative(Value=number_slider_11)
cylinder_4 = Cylinder(Base=mesh_closest_point_6.Point, Radius=number_slider_8, Length=number_slider_7)
cylinder_5 = Cylinder(Base=mesh_closest_point_4.Point, Radius=number_slider_10, Length=number_slider_9)
cylinder_6 = Cylinder(Base=mesh_closest_point_7.Point, Radius=number_slider_12, Length=number_slider_11)
line = Line(StartPoint=mesh_closest_point_5.Point, EndPoint=mesh_closest_point_7.Point)
negative_7 = Negative(Value=number_slider_13)
cylinder_7 = Cylinder(Base=mesh_closest_point_5.Point, Radius=number_slider_14, Length=number_slider_13)
cylinder_8 = Cylinder(Base=mesh_closest_point_2.Point, Radius=number_slider_2, Length=negative)
cylinder_9 = Cylinder(Base=mesh_closest_point.Point, Radius=number_slider_4, Length=negative_2)
cylinder_10 = Cylinder(Base=mesh_closest_point_3.Point, Radius=number_slider_6, Length=negative_3)
cylinder_11 = Cylinder(Base=mesh_closest_point_6.Point, Radius=number_slider_8, Length=negative_4)
cylinder_12 = Cylinder(Base=mesh_closest_point_4.Point, Radius=number_slider_10, Length=negative_5)
cylinder_13 = Cylinder(Base=mesh_closest_point_7.Point, Radius=number_slider_12, Length=negative_6)
cylinder_14 = Cylinder(Base=mesh_closest_point_5.Point, Radius=number_slider_14, Length=negative_7)
merge = Merge(Data1=cylinder_6, Data2=cylinder_13)
line_2 = Line(StartPoint=mesh_closest_point_3.Point, EndPoint=mesh_closest_point_6.Point)
merge_2 = Merge(Data1=cylinder_4, Data2=cylinder_11)
divide_curve = DivideCurve(Curve=line, Count=Slider(41, range=0..100), Kinks=False)  # -> Points, Tangents, Parameters
line_3 = Line(StartPoint=mesh_closest_point_4.Point, EndPoint=mesh_closest_point_3.Point)
merge_3 = Merge(Data1=cylinder_2, Data2=cylinder_9)
merge_4 = Merge(Data1=cylinder, Data2=cylinder_8)
merge_5 = Merge(Data1=cylinder_3, Data2=cylinder_10)
merge_6 = Merge(Data1=cylinder_5, Data2=cylinder_12)
line_4 = Line(StartPoint=mesh_closest_point_2.Point, EndPoint=mesh_closest_point.Point)
merge_7 = Merge(Data1=cylinder_7, Data2=cylinder_14)

geometry_8 = Geometry(merge)
geometry_9 = Geometry(merge_2)
geometry_10 = Geometry(merge_3)
geometry_11 = Geometry(merge_4)
geometry_12 = Geometry(merge_5)
geometry_13 = Geometry(merge_6)
geometry_14 = Geometry(merge_7)

mesh_closest_point_8 = MeshClosestPoint(Point=divide_curve.Points, Mesh=geometry_5)  # -> Point, Index, Parameter
divide_curve_2 = DivideCurve(Curve=line_3, Count=Slider(41, range=0..100), Kinks=False)  # -> Points, Tangents, Parameters
line_5 = Line(StartPoint=mesh_closest_point_7.Point, EndPoint=mesh_closest_point_2.Point)
end_points = EndPoints(Curve=line_2)  # -> Start, End
sphere = Sphere(Base=mesh_closest_point_5.Point, Radius=Slider(2, range=0..10))
end_points_2 = EndPoints(Curve=line_3)  # -> Start, End
line_6 = Line(StartPoint=mesh_closest_point_3.Point, EndPoint=mesh_closest_point_6.Point)
divide_curve_3 = DivideCurve(Curve=line_6, Count=Slider(41, range=0..100), Kinks=False)  # -> Points, Tangents, Parameters
line_7 = Line(StartPoint=mesh_closest_point.Point, EndPoint=mesh_closest_point_4.Point)
divide_curve_4 = DivideCurve(Curve=line_7, Count=Slider(41, range=0..100), Kinks=False)  # -> Points, Tangents, Parameters
mesh_closest_point_9 = MeshClosestPoint(Point=divide_curve_3.Points, Mesh=geometry_5)  # -> Point, Index, Parameter
divide_curve_5 = DivideCurve(Curve=line_4, Count=Slider(41, range=0..100), Kinks=False)  # -> Points, Tangents, Parameters
cap_holes = CapHoles(Brep=geometry_8)
mesh_closest_point_10 = MeshClosestPoint(Point=divide_curve_2.Points, Mesh=geometry_5)  # -> Point, Index, Parameter
cap_holes_2 = CapHoles(Brep=geometry_10)
cap_holes_3 = CapHoles(Brep=geometry_13)
cap_holes_4 = CapHoles(Brep=geometry_11)
end_points_3 = EndPoints(Curve=line_4)  # -> Start, End
vector_2pt = Vector2Pt(PointA=end_points.Start, PointB=end_points.End, Unitize=False)  # -> Vector, Length
cap_holes_5 = CapHoles(Brep=geometry_12)
geometry_15 = Geometry(sphere)
interpolate = Interpolate(Vertices=mesh_closest_point_8.Point, Degree=3, Periodic=False, KnotStyle=1)  # -> Curve, Length, Domain
end_points_4 = EndPoints(Curve=interpolate.Curve)  # -> Start, End
vector_2pt_2 = Vector2Pt(PointA=end_points_2.Start, PointB=end_points_2.End, Unitize=False)  # -> Vector, Length
divide_curve_6 = DivideCurve(Curve=line_5, Count=Slider(41, range=0..100), Kinks=False)  # -> Points, Tangents, Parameters
mesh_closest_point_11 = MeshClosestPoint(Point=divide_curve_4.Points, Mesh=geometry_5)  # -> Point, Index, Parameter
end_points_5 = EndPoints(Curve=line_5)  # -> Start, End
mesh_closest_point_12 = MeshClosestPoint(Point=divide_curve_5.Points, Mesh=geometry_5)  # -> Point, Index, Parameter
cap_holes_6 = CapHoles(Brep=geometry_14)
interpolate_2 = Interpolate(Vertices=mesh_closest_point_9.Point, Degree=3, Periodic=False, KnotStyle=1)  # -> Curve, Length, Domain
construct_plane = ConstructPlane(Origin=mesh_closest_point_8.Point, XAxis=Vector(1, 0, 0), YAxis=Vector(0, 1, 0))
vector_2pt_3 = Vector2Pt(PointA=end_points_4.Start, PointB=end_points_4.End, Unitize=False)  # -> Vector, Length
end_points_6 = EndPoints(Curve=line_7)  # -> Start, End
vector_2pt_4 = Vector2Pt(PointA=end_points_3.Start, PointB=end_points_3.End, Unitize=False)  # -> Vector, Length
interpolate_3 = Interpolate(Vertices=mesh_closest_point_10.Point, Degree=3, Periodic=False, KnotStyle=1)  # -> Curve, Length, Domain
pipe = Pipe(Curve=interpolate_3.Curve, Radius=Slider(1, range=0..2), Caps=Slider(1, range=0..1))
pipe_2 = Pipe(Curve=interpolate_3.Curve, Radius=Slider(1, range=0..2), Caps=Slider(1, range=0..1))
unit_vector = UnitVector(Vector=vector_2pt.Vector)
sphere_2 = Sphere(Base=mesh_closest_point_6.Point, Radius=Slider(2, range=0..10))
pipe_3 = Pipe(Curve=interpolate.Curve, Radius=Slider(1, range=0..2), Caps=Slider(1, range=0..1))
mesh_closest_point_13 = MeshClosestPoint(Point=divide_curve_6.Points, Mesh=geometry_5)  # -> Point, Index, Parameter
unit_vector_2 = UnitVector(Vector=vector_2pt_2.Vector)
vector_2pt_5 = Vector2Pt(PointA=end_points_5.Start, PointB=end_points_5.End, Unitize=False)  # -> Vector, Length
interpolate_4 = Interpolate(Vertices=mesh_closest_point_11.Point, Degree=3, Periodic=False, KnotStyle=1)  # -> Curve, Length, Domain
pipe_4 = Pipe(Curve=interpolate_4.Curve, Radius=Slider(1, range=0..2), Caps=Slider(1, range=0..1))
interpolate_5 = Interpolate(Vertices=mesh_closest_point_12.Point, Degree=3, Periodic=False, KnotStyle=1)  # -> Curve, Length, Domain
pipe_5 = Pipe(Curve=interpolate_5.Curve, Radius=Slider(1, range=0..2), Caps=Slider(1, range=0..1))
pipe_6 = Pipe(Curve=interpolate_2.Curve, Radius=1, Caps=0)
vector_2pt_6 = Vector2Pt(PointA=end_points_6.Start, PointB=end_points_6.End, Unitize=False)  # -> Vector, Length
unit_vector_3 = UnitVector(Vector=vector_2pt_3.Vector)
unit_vector_4 = UnitVector(Vector=vector_2pt_4.Vector)
geometry_16 = Geometry(sphere_2)
interpolate_6 = Interpolate(Vertices=mesh_closest_point_13.Point, Degree=3, Periodic=False, KnotStyle=1)  # -> Curve, Length, Domain
pipe_7 = Pipe(Curve=interpolate_6.Curve, Radius=Slider(1, range=0..2), Caps=Slider(1, range=0..1))
length = Length(Curve=line_2)
unit_vector_5 = UnitVector(Vector=vector_2pt_5.Vector)
negative_8 = Negative(Value=unit_vector)
length_2 = Length(Curve=line_3)
cap_holes_7 = CapHoles(Brep=pipe_6)
negative_9 = Negative(Value=unit_vector_2)
brep_brep = BrepBrep()  # -> Curves, Points
unit_vector_6 = UnitVector(Vector=vector_2pt_6.Vector)
length_3 = Length(Curve=line)
length_4 = Length(Curve=line_4)
negative_10 = Negative(Value=unit_vector_3)
multiplication_15 = Multiplication(A=length, B=Slider(0.25, range=0..1))
negative_11 = Negative(Value=unit_vector_4)
multiplication_16 = Multiplication(A=length_2, B=Slider(0.25, range=0..1))
length_5 = Length(Curve=line_5)
geometry_17 = Geometry(cap_holes_7)
negative_12 = Negative(Value=unit_vector_5)
multiplication_17 = Multiplication(A=length_3, B=Slider(0.25, range=0..1))
length_6 = Length(Curve=line_7)
multiplication_18 = Multiplication(A=length_4, B=Slider(0.25, range=0..1))
amplitude = Amplitude(Vector=negative_8, Amplitude=multiplication_15)
negative_13 = Negative(Value=unit_vector_6)
amplitude_2 = Amplitude(Vector=negative_9, Amplitude=multiplication_16)
multiplication_19 = Multiplication(A=length_5, B=Slider(0.25, range=0..1))
move = Move(Geometry=end_points.End, Motion=amplitude)  # -> Geometry, Transform
amplitude_3 = Amplitude(Vector=negative_10, Amplitude=multiplication_17)
multiplication_20 = Multiplication(A=length_6, B=Slider(0.25, range=0..1))
amplitude_4 = Amplitude(Vector=negative_11, Amplitude=multiplication_18)
move_2 = Move(Geometry=end_points_2.End, Motion=amplitude_2)  # -> Geometry, Transform
amplitude_5 = Amplitude(Vector=negative_12, Amplitude=multiplication_19)
move_3 = Move(Geometry=end_points_4.End, Motion=amplitude_3)  # -> Geometry, Transform
move_4 = Move(Geometry=end_points_3.End, Motion=amplitude_4)  # -> Geometry, Transform
amplitude_6 = Amplitude(Vector=negative_13, Amplitude=multiplication_20)
move_5 = Move(Geometry=end_points_5.End, Motion=amplitude_5)  # -> Geometry, Transform
plane_normal = PlaneNormal(Origin=move.Geometry, ZAxis=unit_vector)
plane_normal_2 = PlaneNormal(Origin=move_2.Geometry, ZAxis=unit_vector_2)
move_6 = Move(Geometry=end_points_6.End, Motion=amplitude_6)  # -> Geometry, Transform
plane_normal_3 = PlaneNormal(Origin=move_3.Geometry, ZAxis=unit_vector_3)
cone = Cone(Base=plane_normal, Radius=Slider(2, range=0..10), Length=multiplication_15)  # -> Cone, Tip
number_slider_15 = Slider(2, range=0..10)
plane_normal_4 = PlaneNormal(Origin=move_4.Geometry, ZAxis=unit_vector_4)
cone_2 = Cone(Base=plane_normal_2, Radius=Slider(2, range=0..10), Length=multiplication_16)  # -> Cone, Tip
plane_normal_5 = PlaneNormal(Origin=move_5.Geometry, ZAxis=unit_vector_5)
cone_3 = Cone(Base=plane_normal_3, Radius=Slider(2, range=0..10), Length=multiplication_17)  # -> Cone, Tip
plane_normal_6 = PlaneNormal(Origin=move_6.Geometry, ZAxis=unit_vector_6)
cone_4 = Cone(Base=plane_normal_4, Radius=Slider(2, range=0..10), Length=multiplication_18)  # -> Cone, Tip
merge_8 = Merge(Data1=cone.Cone, Data2=pipe_2)
merge_9 = Merge(Data1=cone_2.Cone, Data2=pipe)
cap_holes_8 = CapHoles(Brep=cone_3.Cone)
cone_5 = Cone(Base=plane_normal_6, Radius=Slider(2, range=0..10), Length=multiplication_20)  # -> Cone, Tip
geometry_18 = Geometry(merge_8)
merge_10 = Merge(Data1=cone_4.Cone, Data2=pipe_5)
merge_11 = Merge(Data1=cap_holes_8, Data2=pipe_3)
geometry_19 = Geometry(merge_9)
merge_12 = Merge(Data2=pipe_7)
cap_holes_9 = CapHoles(Brep=cone_5.Cone)
merge_13 = Merge(Data1=cap_holes_9, Data2=pipe_4)
geometry_20 = Geometry(merge_10)
geometry_21 = Geometry(merge_11)
geometry_22 = Geometry(merge_12)
geometry_23 = Geometry(merge_13)
construct_point_8 = ConstructPoint(XCoordinate=Slider(97, range=0..100), YCoordinate=Slider(93, range=0..100), ZCoordinate=Slider(10, range=0..10))
construct_point_9 = ConstructPoint(XCoordinate=Slider(9, range=0..100), YCoordinate=Slider(93, range=0..100), ZCoordinate=Slider(10, range=0..10))
query_installed_fonts = QueryInstalledFonts(FontWeight=4, FontStyle=1, FontStretch=5, Symbol=False)
number_slider_16 = Slider(4, range=0..10)
construct_plane_2 = ConstructPlane(Origin=construct_point_9, XAxis=Vector(1, 0, 0), YAxis=Vector(0, 1, 0))
panel_15 = Panel(query_installed_fonts)
line_8 = Line(StartPoint=construct_point_9, EndPoint=construct_point_8)
text_on_surface = TextOnSurface(
    Text="#002//1st Place//Race 03//(9m49s)",
    Font="neue haas",
    Height=Slider(5, range=0..10),
    Depth=Slider(0.573, range=0..10),
    BaseLine=line_8,
    BaseSurface=geometry_5)
divide_length = DivideLength(Curve=line_8, Distance=Slider(3, range=0..100), RoundUp=False, RoundDn=False)
ungroup = Ungroup(Group=text_on_surface)
mesh_closest_point_14 = MeshClosestPoint(Point=divide_length, Mesh=geometry_5)  # -> Point, Index, Parameter
plane_surface = PlaneSurface(Plane=mesh_closest_point_14.Point, XSize=Domain(-10, 10), YSize=Domain(-10, 10))
move_to_plane = MoveToPlane(Geometry=text_on_surface, Plane=plane_surface, Above=True, Below=True)  # -> Geometry, Transform
