# Grasshopper definition LECHNER_OSCAR_L3.gh (Grasshopper 1.0.8)
# plug-ins: PTComponentLibrary, Pancake

height_of_cylinder_test = Slider(1.5, range=0..10)
height_of_cylinder_one_layer = Slider(0.3, range=0..1)
radius_of_cylinder = Slider(10, range=0..10)
unit_z = UnitZ(Factor=height_of_cylinder_test)
# [TODO]: Create Test Cylinder and Move to center of Bed
circle = Circle(Plane=PlaneXY(0, 0, 0), Radius=radius_of_cylinder)
center_coord_of_printer = Slider(105, range=0..1000)
extrude = Extrude(Base=circle, Direction=unit_z)
construct_point = ConstructPoint(XCoordinate=center_coord_of_printer, YCoordinate=center_coord_of_printer, ZCoordinate=0)
cap_holes = CapHoles(Brep=extrude)
move = Move(Geometry=cap_holes, Motion=construct_point)  # -> Geometry, Transform
height_of_one_layer = Slider(0.3, range=0..1)
# [TODO]: Create Contours / Perimeters)
brep = Brep(move.Geometry)
contour = Contour(Shape=brep, Point=construct_point, Direction=unit_z, Distance=height_of_one_layer)
division = Division(A=height_of_cylinder_test, B=height_of_one_layer)
boundary_surfaces = BoundarySurfaces(Edges=contour)
# [TODO]: Create Infill Patterns
bounding_box = BoundingBox(Content=boundary_surfaces, Plane=PlaneXY(0, 0, 0))  # -> Box, Box_2
deconstruct_box = DeconstructBox(Box=bounding_box.Box)  # -> Plane, X, Y, Z
extrusion_width_variable = Slider(1.2, range=0..10)
deconstruct_domain = DeconstructDomain(Domain=deconstruct_box.X)  # -> Start, End
deconstruct_domain_2 = DeconstructDomain(Domain=deconstruct_box.Y)  # -> Start, End
nozzle_diameter = Slider(0.4, range=0..5)
# [TODO]: Combine Perimeters and Infill
number_slider = Slider(0, range=0..100)
subtraction = Subtraction(A=deconstruct_domain.End, B=deconstruct_domain.Start)
extrusion_width = Multiplication(A=extrusion_width_variable, B=nozzle_diameter)
division_2 = Division(A=subtraction, _12=extrusion_width)
# [TODO]: Create Line Segments from Perimeters and Infill
series = Series(Start=number_slider, Step=height_of_one_layer, Count=Slider(6, range=0..10))  # -> graft(Series)
integer = Integer(division_2)
series_2 = Series(Start=deconstruct_domain.Start, Step=extrusion_width, Count=integer)
construct_point_2 = ConstructPoint(XCoordinate=series_2, YCoordinate=deconstruct_domain_2.Start, ZCoordinate=series)
construct_point_3 = ConstructPoint(XCoordinate=series_2, YCoordinate=deconstruct_domain_2.End, ZCoordinate=series)
line = Line(StartPoint=construct_point_2, EndPoint=construct_point_3)
join_curves = JoinCurves(Curves=boundary_surfaces, Preserve=False)
brep_line = BrepLine(Brep=contour, Line=line, LimitToFirst=False)  # -> Curves, Points
merge = Merge(Data1=brep_line.Curves, Data2=join_curves)
merged_lines_and_curve = JoinCurves(Curves=merge, Preserve=False)
divide_distance = DivideDistance(Curve=merged_lines_and_curve, Distance=Slider(0.1, range=0..0.1), AddEnd=Toggle(True))
polyline = PolyLine(Vertices=divide_distance, Closed=False)
simplify_curve = SimplifyCurve(Curve=polyline, Tolerance=Slider(0.1, range=0..0.1))  # -> Curve, Simplified
explode = Explode(Curve=simplify_curve.Curve, Recursive=True)  # -> simplify(Segments), Vertices

# ---- group: A second line for testing
construct_point_4 = ConstructPoint(XCoordinate=Slider(10, range=-10..30), YCoordinate=Slider(10, range=-10..30), ZCoordinate=Slider(1, range=-10..30))
construct_point_5 = ConstructPoint(XCoordinate=Slider(10, range=-10..30), YCoordinate=Slider(20, range=-10..30), ZCoordinate=Slider(1, range=-10..30))
line_2 = Line(StartPoint=construct_point_4, EndPoint=construct_point_5)

# ---- group: Example of a line for testing
# [TODO]: Use lines for testing gcode generation then replace with line segments from slicing
number_slider_2 = Slider(5, range=-10..30)
construct_point_6 = ConstructPoint(XCoordinate=number_slider_2, YCoordinate=Slider(1, range=-10..30), ZCoordinate=Slider(0, range=-10..30))
construct_point_7 = ConstructPoint(XCoordinate=Slider(30, range=-10..30), YCoordinate=Slider(1, range=-10..30), ZCoordinate=Slider(0, range=-10..30))
line_3 = Line(StartPoint=construct_point_6, EndPoint=construct_point_7)

# ----
start_gcode_do_not_edit = Panel("""; #### WARNING: DO NOT EDIT THE START GCODE! #####
;START GCODE
M73 P0 R2; Initial progress
M73 Q0 S2; Initial progress
M201 X1000 Y1000 Z200 E5000 ; sets maximum accelerations mm/sec^2
M203 X200 Y200 Z12 E120 ; sets maximum feedrates mm / sec
M204 S1250 T1250 ; sets acceleration (S) and retract acceleration (R) mm/sec^2
M205 X8.00 Y8.00 Z0.40 E4.50 ; sets the jerk limits mm/sec
M205 S0 T0 ; sets the minimum extruding and travel feed rate mm/sec
;TYPE: "Custom" v20250307a
M862.3 P "MK3S" ; printer model check
M862.1 P0.4 ; nozzle diameter check
M115 U3.14.0 ; tell printer latest fw version
G90 ; use absolute coordinates
M83 ; extruder relative mode
M104 S215 ; set extruder temp
M140 S60 ; set bed temp
M190 S60 ; wait for bed temp
M109 S215 ; wait for extruder temp
G28 W ; home all without mesh bed level
G80 X112.257 Y92.2571 W25.4859 H25.4859 ; mesh bed levelling
G1 Z0.2 F720
G1 Y-3 F1000 ; go outside print area
G92 E0
G1 X60 E9 F1000 ; intro line
G1 X100 E12.5 F1000 ; intro line
M73 P2 R2 ; progress
M73 Q2 S2 ; progress
G92 E0
M221 S95
; Don't change E values below. Excessive value can damage the printer.
M907 E538 ; set extruder motor current
G21 ; set units to millimeters
G90 ; use absolute coordinates
M83 ; use relative distances for extrusion
M900 K0.05 ; Filament gcode LA 1.5
M900 K30 ; Filament gcode LA 1.0
M107""")
end_gcode_do_not_edit = Panel("""; ##### WARNING: DO NOT EDIT THE END GCODE! ######
; END Gcode 
M204 S1000 
M107 
;TYPE:Custom 
; Filament-specific end gcode 
G1 Z180 F720 ; Move print head further up 
G1 X0 Y200 F3600 ; park 
M73 P97 R0
M73 Q97 S0
G4 ; wait
M221 S100 ; reset flow
M900 K0 ; reset LA
M104 S0 ; turn off temperature
M140 S0 ; turn off heatbed
M107 ; turn off fan
M84 ; disable motors
M73 P100 R0 ; print progress done
M73 Q100 S0 ; print progress done""")
# [TODO]: Initialize Input Parameters
number_slider_3 = Slider(0.4, range=0..1)
# NOTE THAT THIS GCODE OUTPUT ASSUMES:
# - A PRUSA MK3S+ as the Printer
# - PLA Material
# - Extrusion Temperature: 215C
# - Heated Bed Temperature: 60C
travel_feed_rate = Panel("1200")
# [TODO]: Implement the gcode generation algorithm in Python
python_3_script_generate_gcode = Python3Script(
    lines=flatten(explode.Segments),
    nozzle_diameter=number_slider_3,
    filament_diameter=Slider(1.75, range=0..10),
    layer_height=Slider(0.3, range=0..1),
    extrusion_width=Slider(0.48, range=0..10),
    travel_feed_rate=travel_feed_rate,
    layer_change_feed_rate=Slider(720, range=0..1000),
    extrusion_feed_rate=Slider(600, range=0..1000),
    start_gcode_lines=start_gcode_do_not_edit,
    end_gcode_lines=end_gcode_do_not_edit)  # -> out, gcode_output; inputs lines: list of Line, nozzle_diameter: Double, filament_diameter: Double, layer_height: Double, extrusion_width: Double, travel_feed_rate: Double, layer_change_feed_rate: Double, extrusion_feed_rate: Double, start_gcode_lines: list of String, end_gcode_lines: list of String
# ---------- python_3_script_generate_gcode: Python ----------
"""
    This file contains parameters, helpers, and setup to 
    create a basic gcode generation algorithm from line segments.
    
    The main 
    
    Inputs:
        lines: the line segments to be converted into gcode commands for extrusion 
        nozzle_diameter: the diameter of the 3D printer's nozzle
        filament_diameter: the diameter of the 3d printing filament
        layer_height: the height of each layer in the print
        extrusion_width: the width of the extruded line from the printer
        travel_feed_rate: the speed at which the extruder moves in X and Y
        layer_change_feed_rate: the speed at which teh extruder moves when 
            changing layers in the Z direction
        extrusion_feed_rate: the speed at which the extruder move when extruding

    Output:
        gcode_output: a string with gcode commands separate by new-lines"""

__author__ = "mrivera-cu"

import rhinoscriptsyntax as rs

import math


########## CONSTANTS BELOW ###############

# GCODE COMMANDS
COMMAND_MOVE = "G1"

# GCODE PARAM NAMES
PARAM_X = "X"
PARAM_Y = "Y"
PARAM_Z = "Z"
PARAM_E = "E"
PARAM_F = "F"

# Separates commands
COMMAND_DELIMITER = "\n"

# Precision for converting floats to strings
E_VALUE_PRECISION = 5
XYZ_VALUE_PRECISION = 3

# Float equality precision
FLOAT_EQUALITY_PRECISION = 5

# Converts a float (f) to a string with some precision of decimal places
# For example: 
# Input: f=0.1234, precision=3 
# Output: "0.123"
def float_to_string(f, precision=XYZ_VALUE_PRECISION): 
    f = float(f)
    str_format = "{value:." + str(precision) +"f}"
    return str_format.format(value=f)
    
# Helper to convert the E value to the proper precision
def e_value_to_string(e):
    return float_to_string(e, E_VALUE_PRECISION)

# Helper to convert the XYZ value to the proper precision
def xyz_value_to_string(e):
    return float_to_string(e, XYZ_VALUE_PRECISION)

#########################################################################

# Helper function to compare floats in grasshopper/python due to float precision errors
def are_floats_equal(f1, f2, epsilon=10**(-FLOAT_EQUALITY_PRECISION)):
    f1 *= 10**FLOAT_EQUALITY_PRECISION
    f2 *= 10**FLOAT_EQUALITY_PRECISION
    return math.fabs(f2 - f1) <= epsilon
    
# Helper function to compare if two points are equal (have the same coordinates)
# by handling float precision comparisons
def is_same_pt(ptA, ptB):
    return are_floats_equal(ptA[0], ptB[0]) and are_floats_equal(ptA[1], ptB[1]) and are_floats_equal(ptA[2], ptB[2])
     
     
########################################################################
# creates a string consisting of a G1 move command and 
# any associated parameters
def gcode_move(current_pos, next_pos, feed_rate=None, should_extrude=False):
    # Start with "G1" as command
    move_command_str = COMMAND_MOVE
    
    # Compare X positions
    if (not are_floats_equal(current_pos[0],next_pos[0])):
        # we have a different x position so add it as a parameter to the command
        x_value = float_to_string(next_pos[0], precision=XYZ_VALUE_PRECISION)
        # Add X<x_value> to move string, e.g., X100.00
        move_command_str += " " + PARAM_X + x_value
    
    # Compare Y positions
    if (not are_floats_equal(current_pos[1], next_pos[1])):
        # we have a different y position so add the new position as a parameter
        y_value = float_to_string(next_pos[1], precision=XYZ_VALUE_PRECISION)
        # Add Y<y_value> to move string, e.g., Y100.00
        move_command_str += " " + PARAM_Y + y_value
    
    # Compare Z position
    if (not are_floats_equal(current_pos[2], next_pos[2])):
        # we have a different z position so add the new position as a parameter
        z_value = float_to_string(next_pos[2], precision=XYZ_VALUE_PRECISION)
        # Add Z<z_value> to move string, e.g., Z100.00
        move_command_str += " " + PARAM_Z + z_value
    
    # [TODO]: handle "should_extrude" == true by determining the proper amount to
    # extrude using the capsule model, then append the E parameter and value
    # to the move command.
    # NOTE: YOUR FLOAT PRECISION MUST MATCH E_VALUE_PRECISION
    if should_extrude:
        dx = next_pos[0] - current_pos[0]
        dy = next_pos[1] - current_pos[1]
        dz = next_pos[2] - current_pos[2]
        distance = math.sqrt(dx**2 + dy**2 + dz**2)
        
        # Capsule model: rectangle + semicircles
        rect_area = extrusion_width * layer_height
        semi_circles_area = 0.25 * math.pi * layer_height**2
        v_out = distance * (rect_area + semi_circles_area)

        # Filament volume = π * (r^2)
        filament_radius = filament_diameter / 2
        filament_area = math.pi * filament_radius**2
        e_value = v_out / filament_area

        # Only emit E value if it's within a sane range (typically 0 < E < ~5 for normal segment lengths)
        if e_value > 0.0 and e_value < 5:
            e_str = e_value_to_string(e_value)
            move_command_str += " " + PARAM_E + e_str
    
    
    # See if we have a feedrate to use, and handle it differently than other 
    # parameters as it is an integer value
    if (feed_rate is not None):
        # feed rate is an int
        feed_rate_value = round(feed_rate)
        # Add F<feed_rate_value> to move string, e.g., F2000
        move_command_str += " " + PARAM_F + str(feed_rate_value)   
    
    # Remove excess whitespace on ends
    move_command_str = move_command_str.strip(" ")
    return move_command_str


############################################
############################################
############################################
    
''' Here's the main method of the script that uses the helper methods above '''

def generate_gcode():
    current_position = [0, 0, 0]        # start extruder at the origin
    all_move_commands = []             # list to hold for all the move commands

    for i in range(0, len(lines)):
        line = lines[i]
        start = line.From
        end = line.To
        start_pos = [start.X, start.Y, start.Z]
        end_pos = [end.X, end.Y, end.Z]

        # Step 1: Z change (layer change)
        if not are_floats_equal(current_position[2], start_pos[2]):
            z_only_pos = [current_position[0], current_position[1], start_pos[2]]
            layer_move_cmd = gcode_move(current_position, z_only_pos, feed_rate=layer_change_feed_rate)
            all_move_commands.append(layer_move_cmd)
            current_position = z_only_pos

        # Step 2: Travel move to start of segment if necessary
        if not is_same_pt(current_position, start_pos):
            travel_cmd = gcode_move(current_position, start_pos, feed_rate=travel_feed_rate)
            all_move_commands.append(travel_cmd)
            current_position = start_pos

        # Step 3: Extrude along the segment
        extrude_cmd = gcode_move(current_position, end_pos, feed_rate=extrusion_feed_rate, should_extrude=True)
        all_move_commands.append(extrude_cmd)
        current_position = end_pos

    # Step 4: Combine with start and end gcode
    gcode_lines = start_gcode_lines + all_move_commands + end_gcode_lines

    # Final output
    output = COMMAND_DELIMITER.join(gcode_lines)
    return output

    
''' RUN THE MAIN FUNCITON ABOVE - DO NOT EDIT '''
# this sets the gcode commands to be the the `gcode_output` variable of this grasshopper component
gcode_output = generate_gcode()
# ---------- end python_3_script_generate_gcode ----------
the_gcode_output = Panel(python_3_script_generate_gcode.gcode_output)
debugging_panel = Panel(python_3_script_generate_gcode.out)
true_only_button = TrueOnlyButton(LastSaveLocalization="neutral,N")
# [TODO]: Use Pancake Plug-in to Export Gcode Output File as .gcode
text_trim = TextTrim(Text=the_gcode_output, Start=True, End=True)
export_txt = ExportTXT(
    Content=text_trim,
    FileLocation="H:\Downloads\\LECHNER_OSCAR_output.gcode",
    Overwrite=Toggle(True),
    Encoding="utf-8",
    Export=true_only_button,
    LastSaveLocalization="neutral,N")
panel = Panel(export_txt)
